# Grasshopper definition still_life.gh (Grasshopper 1.0.7)

# 2. Turn on timer
timer = Timer(TimerInterval=5, Target=[c_script_10, c_script, c_script_9, c_script_3])  # disabled
# 1. Press button
button = Button()
mesh = Mesh(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)
bbox = BoundingBox(Content=mesh, Plane=PlaneXY(0, 0, 0))  # -> Box, Box_2
demesh = DeconstructMesh(Mesh=mesh)  # -> Vertices, Faces, Colours, Normals
c_script = CSharpScript(reset=button)  # -> out, framerate; inputs reset: Boolean
# ---------- c_script: C# usings ----------
using System.IO;
using System.Linq;
using System.Data;
using System.Drawing;
using System.Reflection;
using System.Windows.Forms;
using System.Xml;
using System.Xml.Linq;
using System.Runtime.InteropServices;

using Rhino.DocObjects;
using Rhino.Collections;
using GH_IO;
using GH_IO.Serialization;
# ---------- c_script: C# ----------
    num = reset ? 0 : num + 1;
    framerate = num;
    Print(num.ToString());
# ---------- c_script: C# additional code ----------
  private int num = 0;
# ---------- end c_script ----------
mesh_2 = Mesh(<mesh referenced from the Rhino model>)
c_script_2 = CSharpScript(x=bbox.Box)  # -> out, A; inputs x: Box
# ---------- c_script_2: C# ----------
    A = x.Center;
# ---------- end c_script_2 ----------
c_script_3 = CSharpScript(reset=button)  # -> out, framerate; inputs reset: Boolean; same code as c_script
mesh_3 = Mesh(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)
c_script_4 = CSharpScript(x=c_script.framerate)  # -> out, A; inputs x: Double
# ---------- c_script_4: C# ----------
    A = Math.Sin(x) * 0.3;
# ---------- end c_script_4 ----------
c_script_5 = CSharpScript(x=c_script.framerate)  # -> out, A; inputs x: Double
# ---------- c_script_5: C# ----------
    A = Math.Sin(x);
# ---------- end c_script_5 ----------
c_script_6 = CSharpScript(skin=mesh_3)  # -> out, SkinEdge, SkinVer; inputs skin: Mesh
# ---------- c_script_6: C# ----------
    Polyline[] skinedge = skin.GetNakedEdges();
    SkinEdge = skinedge;
    SkinVer = skin.Vertices;
# ---------- end c_script_6 ----------
demesh_2 = DeconstructMesh(Mesh=mesh_2)  # -> Vertices, Faces, Colours, Normals
c_script_7 = CSharpScript(x=c_script_3.framerate)  # -> out, A; inputs x: Int32
# ---------- c_script_7: C# ----------
    int time = (10 * x) % 500;
    A = time;
# ---------- end c_script_7 ----------
c_script_8 = CSharpScript(skinEdge=c_script_6.SkinEdge, skinVer=c_script_6.SkinVer)  # -> out, ScalePlane, ScaledEdge, ExtrudedEdge, LoftSrf, A; inputs skinEdge: Curve, skinVer: list of Point3d
# ---------- c_script_8: C# ----------
    Curve edge = skinEdge;

    //find plane fits the verticies
    double dev;
    Plane planescale;
    Plane.FitPlaneToPoints(skinVer, out planescale, out dev);

    //move plane to a point on the edge of the skin
    Point3d p = planescale.Origin + skinVer[20];
    Vector3d v = new Vector3d(p);
    Transform tr = Transform.Translation(v);
    planescale.Transform(tr);

    //scale edge of the skin
    Transform t = Transform.Scale(planescale, 10, 8, 8);
    edge.Transform(t);
    Curve sEdge = edge;

    //rebuild scaled edge (not working??)
    edge.Rebuild(10, 3, true);
    Curve rEdge = edge;

    //extrude scaled edge
    Vector3d vec = new Vector3d(0, 100, 100);
    Surface s = Surface.CreateExtrusion(rEdge, vec);


    //loft doesn't work...
    List <Curve> loft = new List <Curve>();
    loft.Add(edge);
    loft.Add(skinEdge);
    Brep[] b;
    b = Brep.CreateFromLoftRebuild(loft, Point3d.Unset, Point3d.Unset, 0, false, 10);

    //output
    ScalePlane = planescale;
    ScaledEdge = sEdge;
    LoftSrf = b;
    ExtrudedEdge = s;
    A = rEdge;
# ---------- end c_script_8 ----------
panel = Panel(c_script_7.A)
points = PointList(Points=demesh_2.Vertices, Size=Slider(0, range=0..1))
c_script_9 = CSharpScript(reset=button, startPts=demesh_2.Vertices, mouthMag=c_script_4.A)  # -> out, A, B, C, D; inputs reset: Boolean, startPts: list of Point3d, targetPts: list of Point3d, mouthMag: Double
# ---------- c_script_9: C# ----------
    //Empty point list and speed list
    ptList = new List<Point3d>();
    speedList = new List<Vector3d>();
    selectedList = new List<Point3d>();
    tpList = targetPts;

    mouthDir = mouthMag;

    // Reset the agent simulation
    if(reset){
      //empty the agent list
      agentList = new List<Agent>();
      simulationCount = 0;

      //declare the agents and add to the agent list

      for(int i = 0; i < startPts.Count; i++){
        Agent agent01 = new Agent(startPts[i]);
        agentList.Add(agent01);
      }
    }

      //Run the agent simulation
    else{

      //Run the agent simulation

      //agentList.Count
      for(int i = 0; i < agentList.Count; i++){
        //Run agents
        Agent agent01 = agentList[i];
        agent01.run(i);

        //Update the location list and speed list
        ptList.Add(agent01.loc);
        speedList.Add(agent01.speed);

      }

      /*
      System.Threading.Tasks.Parallel.For(0, agentList.Count, i => {
        {
          //Run agents
          Agent agent01 = agentList[i];
          agent01.run();

          lock(agentList){
            //Update the location list and speed list
            ptList.Add(agent01.loc);
            speedList.Add(agent01.speed);
          }
        }
        });
      */

      //Add one value to the simulation count
      simulationCount++;
    }

    A = ptList;
    B = speedList;
    C = simulationCount;
    D = selectedList;
# ---------- c_script_9: C# additional code ----------
  //Global Variable List
  static List<Agent> agentList = new List<Agent>();
  static List<Point3d> ptList = new List<Point3d>();
  static List<Vector3d> speedList = new List<Vector3d>();
  static List<Point3d> selectedList = new List<Point3d>();

  static List<Point3d> tpList;

  static int simulationCount;

  static double mouthDir;

  //Agent
  public class Agent{
    //Class variables
    public Point3d loc = new Point3d();
    public Vector3d speed = new Vector3d();

    Vector3d accel = new Vector3d();
    double maxSpeed = 1.00;

    //Class constructor
    public Agent(Point3d _loc){
      loc = _loc;
    }

    public void run(int i){
      //move();
      openMouth(i);
      //expand();
      //attract(i);
    }

    //move each agent based on a speed vector
    void move(){
      //speed = new Vector3d(0, 0, 0);
      speed += accel;
      if(speed.Length > maxSpeed){
        speed.Unitize();
        speed *= maxSpeed;
      }
      loc += speed;

      accel = new Vector3d(0, 0, 0);
    }

    void expand(){
      Vector3d dir = new Vector3d();
      Point3d center = new Point3d();
      Vector3d v1 = loc - center;
      v1.Unitize();
      dir += v1;
      dir *= 2;

      accel += dir;
    }

    void openMouth(int i){
      if ( i == 2274 || i == 2270 || i == 2269 || i == 11 || i == 2280 || i == 2282 || i == 2277 || i == 2276 || i == 2267 || i == 2271 || i == 12 || i == 2273){
        selectedList.Add(loc);
        up();
      }

      if (i == 2262 || i == 2263 || i == 2264 || i == 2265 || i == 7 || i == 2260 || i == 2258 || i == 2257 || i == 1 || i == 4 || i == 5 || i == 0 || i == 2266 || i == 8 || i == 6){
        selectedList.Add(loc);
        down();
      }

      // i == 2266 || i == 7 || i == 8 || i == 6
      //i == 2260 || i == 2258 || i == 2257 || i == 1 || i == 4 || i == 5
      //if (i == 12){
      //selectedList.Add(loc);
      //up();
      //}

    }

    void up(){
      Vector3d dir = new Vector3d(0, 0, mouthDir);
      loc += dir;
    }

    void down(){
      Vector3d dir = new Vector3d(0, 0, -mouthDir * 0.6);
      loc += dir;
    }

    void attract(int i){
      Vector3d dir = new Vector3d();
      Point3d center = tpList[i];
      Vector3d v1 = center - loc;
      v1.Unitize();
      dir += v1;
      dir *= 2;

      accel += dir;
    }

    void wave(){
      Vector3d dir = new Vector3d();
      Point3d center = new Point3d();
      Vector3d v1 = loc - center;
      v1.Unitize();
      dir += v1;


    }
  }

  //Instantiate only once using clock
  RangedRandom rand = new RangedRandom();


  //New RangedRandom class definition that inherits from System.Random
  class RangedRandom : System.Random
  {
    //clock-seeded constructor
    public RangedRandom(): base(){}

    //seeded constructor
    public RangedRandom(int seed): base(seed){}

    public double NextDouble(double max){
      return NextDouble() * max;
    }

    public double NextDouble(double min, double max){
      return (max - min) * NextDouble() + min;
    }
  }
# ---------- end c_script_9 ----------
c_script_10 = CSharpScript(reset=button, startPts=demesh.Vertices, centerPt=c_script_2.A, zoomDir=c_script_5.A)  # -> out, A, B, C, D, E; inputs reset: Boolean, startPts: list of Point3d, targetPts: list of Point3d, centerPt: Point3d, zoomDir: Double
# ---------- c_script_10: C# ----------
    //Empty point list and speed list
    ptList = new List<Point3d>();
    speedList = new List<Vector3d>();
    tpList = targetPts;
    center = centerPt;
    zoomMag = zoomDir;

    Print("c:" + center);

    // Reset the agent simulation
    if(reset){
      //empty the agent list
      agentList = new List<Agent>();
      simulationCount = 0;

      //declare the agents and add to the agent list
      for(int i = 0; i < startPts.Count; i++){
        Agent agent01 = new Agent(startPts[i]);
        agentList.Add(agent01);
      }
    }

      //Run the agent simulation
    else{

      //Run the agent simulation

      for(int i = 0; i < agentList.Count; i++){
        //Run agents
        Agent agent01 = agentList[i];
        agent01.run(i);

        //Update the location list and speed list
        ptList.Add(agent01.loc);
        speedList.Add(agent01.speed);
      }

      /*
      System.Threading.Tasks.Parallel.For(0, agentList.Count, i => {
        {
          //Run agents
          Agent agent01 = agentList[i];
          agent01.run();

          lock(agentList){
            //Update the location list and speed list
            ptList.Add(agent01.loc);
            speedList.Add(agent01.speed);
          }
        }
        });
      */

      //Add one value to the simulation count
      simulationCount++;
    }

    A = ptList;
    B = speedList;
    C = simulationCount;
    D = selectedList;
    E = distList;
# ---------- c_script_10: C# additional code ----------
  //Global Variable List
  static List<Agent> agentList = new List<Agent>();
  static List<Point3d> ptList = new List<Point3d>();
  static List<Vector3d> speedList = new List<Vector3d>();

  static List<Point3d> tpList;
  static List<Point3d> selectedList = new List<Point3d>();
  static List<double> distList = new List<double>();
  static Point3d center;

  static int simulationCount;

  static double zoomMag;

  //Agent
  public class Agent{
    //Class variables
    public Point3d loc = new Point3d();
    public Vector3d speed = new Vector3d();

    Vector3d accel = new Vector3d();
    double maxSpeed = 1.00;

    //Class constructor
    public Agent(Point3d _loc){
      loc = _loc;
    }

    public void run(int i){
      selectGreen();
      move();
      expand();
      //attract(i);
    }

    //move each agent based on a speed vector
    void move(){
      //speed = new Vector3d(0, 0, 0);
      speed += accel;
      if(speed.Length > maxSpeed){
        speed.Unitize();
        speed *= maxSpeed;
      }
      loc += speed;

      accel = new Vector3d(0, 0, 0);
    }

    void selectGreen(){
      double dist = loc.DistanceTo(center);
      distList.Add(dist);
      if (dist > 12){
        selectedList.Add(loc);
      }
    }

    void expand(){
      Vector3d dir = new Vector3d();
      //Point3d center = new Point3d();
      Vector3d v1 = loc - center;
      v1.Unitize();
      dir += v1;
      dir *= zoomMag;

      accel += dir;
    }

    void attract(int i){
      Vector3d dir = new Vector3d();
      Point3d center = tpList[i];
      Vector3d v1 = center - loc;
      v1.Unitize();
      dir += v1;
      dir *= 2;

      accel += dir;
    }

    void wave(){
      Vector3d dir = new Vector3d();
      Point3d center = new Point3d();
      Vector3d v1 = loc - center;
      v1.Unitize();
      dir += v1;


    }
  }

  //Instantiate only once using clock
  RangedRandom rand = new RangedRandom();


  //New RangedRandom class definition that inherits from System.Random
  class RangedRandom : System.Random
  {
    //clock-seeded constructor
    public RangedRandom(): base(){}

    //seeded constructor
    public RangedRandom(int seed): base(seed){}

    public double NextDouble(double max){
      return NextDouble() * max;
    }

    public double NextDouble(double min, double max){
      return (max - min) * NextDouble() + min;
    }
  }
# ---------- end c_script_10 ----------
crv = Curve(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)
loft = Loft(
    Curves=[c_script_6.SkinEdge, c_script_8.ScaledEdge],
    Options={Adjust=False, Closed=False, LoftEnds=0, LoftSimp=1, LoftType=0, Rebuild=10, Refit=0.01})
c_script_11 = CSharpScript(straw=crv, time=c_script_7.A)  # -> out, A, C; inputs straw: Curve, time: Int32
# ---------- c_script_11: C# ----------
    double seg_length = 0.04;
    Point3d [] dividedPt_length;
    double [] para_length;
    para_length = straw.DivideByLength(seg_length, true, out dividedPt_length);



    //sphere
    double radius_normal = 0.2;
    //double [] radius;
    double a = 0.4;
    int s = 2;
    double b = s * a;
    int section_num = (int) Math.Floor(b / seg_length) - 3;


    List<Circle> c = new List<Circle>();

    for ( int j = 0; j < time - section_num; j++)
    {

      Vector3d tangent = straw.TangentAt(para_length[j]);
      Plane pl = new Plane(dividedPt_length[j], tangent);
      Circle circle_loft = new Circle(pl, radius_normal);
      c.Add(circle_loft);

    }

    for ( int j = time - section_num; j < time + section_num + 1; j++)
    {
      double y = Math.Abs(j - time) * seg_length;
      double x = Math.Sqrt(a * a - (y / s) * (y / s));

      Vector3d tangent = straw.TangentAt(para_length[j]);
      Plane pl = new Plane(dividedPt_length[j], tangent);
      Circle circle_loft = new Circle(pl, x);
      c.Add(circle_loft);

    }


    for ( int j = time + section_num + 1; j < dividedPt_length.Length; j++)
    {

      Vector3d tangent = straw.TangentAt(para_length[j]);
      Plane pl = new Plane(dividedPt_length[j], tangent);
      Circle circle_loft = new Circle(pl, radius_normal);
      c.Add(circle_loft);

    }

    A = dividedPt_length;
    C = c;
# ---------- end c_script_11 ----------
pt = Point(c_script_9.D)
viewer = ParamViewer(c_script_9.A)
cap_holes_ex = CapHolesEx(Brep=[loft, c_script_8.ExtrudedEdge])  # -> Brep, Caps, Solid
brep = Brep(c_script_8.ExtrudedEdge)
curve = Curve(c_script_8.ScaledEdge)
curve_2 = Curve(c_script_8.A)
number_slider = Slider(255, range=0..1000)

crv_2 = Curve([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])
c_script_12 = CSharpScript(x=crv_2, time=c_script_3.framerate)  # -> out, A, B; inputs x: list of Curve, time: Int32
# ---------- c_script_12: C# ----------
    Curve[] Juice = Curve.CreateTweenCurves(x[0], x[1], 500);
    List<Curve> J = new List<Curve>();
    J.Add(Juice[499]);
    int a = Math.Min(499, 250 + time);
    J.Add(Juice[a]);




    Brep[] juice = Brep.CreateFromLoft(J, Point3d.Unset, Point3d.Unset, LoftType.Normal, true);
    A = J;
    B =Juice[a];
# ---------- end c_script_12 ----------

geo = Geometry(c_script_11.C)
gradient = Gradient(
    LowerLimit=Slider(7, range=0..10),
    UpperLimit=Slider(13, range=0..100),
    Parameter=c_script_10.E,
    stops=[0: RGB(221, 160, 221), 0.63: RGB(199, 21, 133), 0.82: RGB(189, 183, 107), 1: RGB(107, 142, 35)])
conmesh = ConstructMesh(Vertices=c_script_9.A, Faces=demesh_2.Faces)
geo_2 = Geometry(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)
loft_2 = Loft(Curves=geo, Options={Adjust=False, Closed=False, LoftEnds=0, LoftSimp=0, LoftType=0, Rebuild=10, Refit=0.01})
rgb = ColourRGB(Alpha=Slider(100, range=0..100), Red=Slider(255, range=0..1000), Green=0, Blue=Slider(100, range=0..100))
rgb_2 = ColourRGB(Alpha=Slider(100, range=0..100), Red=number_slider, Green=number_slider, Blue=number_slider)
boundary = BoundarySurfaces(Edges=c_script_12.B)
geo_3 = Geometry(c_script_12.A)
custom_preview = CustomPreview(
    Geometry=conmesh,
    Material={diffuse=RGB(250, 250, 250), emission=RGB(0, 0, 0), shine=0.85, specular=RGB(217, 217, 217), transparency=0})
loft_3 = Loft(Curves=geo_3, Options={Adjust=False, Closed=False, LoftEnds=0, LoftSimp=0, LoftType=0, Rebuild=10, Refit=0.01})
conmesh_2 = ConstructMesh(Vertices=c_script_10.A, Faces=demesh.Faces, Colours=gradient)
c_script_13 = CSharpScript(x=cap_holes_ex.Brep, y=conmesh_2)  # -> out, A, B; inputs x: Mesh, y: Mesh
# ---------- c_script_13: C# ----------
    Mesh[] a;
    //Mesh[] mesh;

    // mesh = Mesh.CreateBooleanIntersection(b, c);


    x.Flip(true, true, true);

    List <Mesh> b = new List <Mesh> ();
    b.Add(x);
    List <Mesh> c = new List <Mesh> ();
    c.Add(y);
    a = Mesh.CreateBooleanDifference(c, b);


    a[0].FillHoles();
    A = a[0];
# ---------- end c_script_13 ----------
preview = CustomPreview(Geometry=[loft_2, loft_3, boundary], Material=rgb)
preview_2 = CustomPreview(Geometry=geo_2, Material=rgb_2)
item = ListItem(List=c_script_13.A, Index=Slider(0, range=0..100), Wrap=True)
mesh_4 = Mesh(item)
manipulate_colors = CSharpScript(m=mesh_4)  # -> out, new_m, F, V; inputs m: Mesh
# ---------- manipulate_colors: C# usings ----------
using System.Drawing;
# ---------- manipulate_colors: C# ----------
    for(int i = 0; i < m.Vertices.Count; i++){

      if (Convert.ToInt32(m.VertexColors[i].R) == m.VertexColors[i].B)
      {

        int new_R = 199;
        int new_G = 21;
        int new_B = 133;

        Color c = Color.FromArgb(new_R, new_G, new_B);
        m.VertexColors.SetColor(i, c);


      }
    }
    // output mesh with new colors
    new_m = m;
# ---------- end manipulate_colors ----------
mesh_5 = Mesh(manipulate_colors.new_m)
